# Grasshopper definition updown.gh (Grasshopper 1.0.7)

# ---- group: sample data
txt = Text(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)
panel = Panel(".obj")

panel_2 = Panel(".fbx")
txt_2 = Text(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)

# ----
encodedfile = GetString(txt_2, AtLeast=1, AtMost=1, TreeAccess=False)
extension = GetString(panel_2, AtLeast=1, AtMost=1, TreeAccess=False)
check1 = GetBoolean(Toggle(False), AtLeast=1, AtMost=1, FalseValue="False", TreeAccess=False, TrueValue="True")
check2 = GetBoolean(Toggle(False), AtLeast=1, AtMost=1, FalseValue="False", TreeAccess=False, TrueValue="True")
check3 = GetBoolean(Toggle(False), AtLeast=1, AtMost=1, FalseValue="False", TreeAccess=False, TrueValue="True")
c_script = CSharpScript(data=encodedfile, ext=extension)  # -> out, A; inputs data: String, ext: String
# ---------- c_script: C# usings ----------
using System.IO;
# ---------- c_script: C# ----------
    if( null == data || null == ext ) return;

    var decodedData = Convert.FromBase64String(data);

    var tmpPath = Path.GetTempFileName();
    tmpPath = Path.ChangeExtension(tmpPath, ext);

    Print(tmpPath);

    File.WriteAllBytes(tmpPath, decodedData);

    if(File.Exists(tmpPath))
    {
      using( var doc = Rhino.RhinoDoc.CreateHeadless(null)){

        doc.Import(tmpPath);

        var ros = doc.Objects.FindByObjectType(Rhino.DocObjects.ObjectType.Mesh);

        Print("Number of meshes: {0}", ros.Length);

        var meshes = new List<Rhino.Geometry.Mesh>();
        foreach( Rhino.DocObjects.RhinoObject obj in ros )
        {
          meshes.Add(obj.DuplicateGeometry() as Rhino.Geometry.Mesh);
        }

        A = meshes;
      }
    }
# ---------- end c_script ----------
slider2 = GetNumber(Slider(0, range=0..10), AtLeast=1, AtMost=1, Maximum=1.797693135e+308, Minimum=-1.797693135e+308, TreeAccess=False)
slider1 = GetNumber(Slider(0, range=0..10), AtLeast=1, AtMost=1, Maximum=1.797693135e+308, Minimum=-1.797693135e+308, TreeAccess=False)
slider3 = GetNumber(Slider(0, range=0..10), AtLeast=1, AtMost=1, Maximum=1.797693135e+308, Minimum=-1.797693135e+308, TreeAccess=False)
slider5 = GetNumber(Slider(0, range=0..10), AtLeast=1, AtMost=1, Maximum=1.797693135e+308, Minimum=-1.797693135e+308, TreeAccess=False)
slider4 = GetNumber(Slider(0, range=0..10), AtLeast=1, AtMost=1, Maximum=1.797693135e+308, Minimum=-1.797693135e+308, TreeAccess=False)
addition = Addition(A=check2, B=1)
addition_2 = Addition(A=check1, B=1)
addition_3 = Addition(A=check3, B=1)
panel_3 = Panel(c_script.out)
multiplication = Multiplication(A=addition, B=1.3)
multiplication_2 = Multiplication(A=addition_2, B=1.3)
multiplication_3 = Multiplication(A=addition_3, B=1.3)
scale_nu = ScaleNU(Geometry=c_script.A, Plane=PlaneXY(0, 0, 0), ScaleX=multiplication_2, ScaleY=multiplication, ScaleZ=multiplication_3)  # -> Geometry, Transform
scale_nu_2 = ScaleNU(Geometry=scale_nu.Geometry, Plane=PlaneXY(0, 0, 0), ScaleX=slider1, ScaleY=slider2, ScaleZ=slider3)  # -> Geometry, Transform
scale_nu_3 = ScaleNU(Geometry=scale_nu_2.Geometry, Plane=PlaneXY(0, 0, 0), ScaleX=slider4, ScaleY=slider5, ScaleZ=1)  # -> Geometry, Transform

# ---- group: RH_OUT:meshes
mesh = Mesh(scale_nu_3.Geometry)
